% Requirement links of FuelSysWithReqLinks.slx (R2017b)

model links to FuelSysDesignDescription.docx: Design Description Microsoft Word Document
block :140 links to FuelSysDesignDescription.docx#@Simulink_requirement_item_5: Manifold pressure failure
block :15 links to FuelSysRequirementsSpecification.docx#@Simulink_requirement_item_1: Normal Mode of Operation
block :158 links to FuelSysDesignDescription.docx#@Simulink_requirement_item_7: This section will be deleted
block :168:26 links to FuelSysDesignDescription.docx#@Simulink_requirement_item_4: Enriched mixture usage
block :168:30 links to FuelSysRequirementsSpecification.docx#@Simulink_requirement_item_3: During a calibratible warm up period the oxygen sensor correction shall be disabled.
block :168:4 links to FuelSysRequirementsSpecification.docx#@Simulink_requirement_item_3: During a calibratible warm up period the oxygen sensor correction shall be disabled.
block :168:40 links to FuelSysDesignDescription.docx#@Simulink_requirement_item_6: Speed sensor failure detection
block :177.1 links to FuelSysTestScenarios.xlsx#@Simulink_requirement_item_3: Normal mode of operation
block :20 links to FuelSysRequirementsSpecification.docx#@Simulink_requirement_item_2: Stoichiometric mixture ratio
block :62 links to FuelSysDesignDescription.docx#@Simulink_requirement_item_1: Throttle Sensor
block :65 links to FuelSysDesignDescription.docx#@Simulink_requirement_item_2: Manifold Absolute Pressure Sensor
block :66 links to FuelSysDesignDescription.docx#@Simulink_requirement_item_3: Mass airflow estimation
block :7 links to FuelSysTestScenarios.xlsx#@Simulink_requirement_item_2: The System detects the Manifold Absolute Pressure sensor short to ground or open circuit by monitoring when the signal is below a calibratable threshold. The failure is detected within 100mSec of the occurance and the MAP sensor reading is reverted to an estimated throttle position based on engine speed and throttle position.
block :82 links to FuelSysRequirementsSpecification.docx#@Simulink_requirement_item_4: High Oxygen Level
block :91 links to FuelSysRequirementsSpecification.docx#@Simulink_requirement_item_5: Fuel-rich Mixture